# Grasshopper definition 1 layer perceptron.gh (Grasshopper 1.0.7)
# plug-ins: Kangaroo2 Components

b = Slider(6.4, range=-40..40)
w_x = Slider(2.1, range=-10..10)
w_y = Slider(0.7, range=-10..10)
pt = ConstructPoint(XCoordinate=w_x, YCoordinate=w_y, ZCoordinate=0)

# ----
# xi with yi = -1
grid_size = Slider(6, range=0..10)
vertical_pos = Slider(10, range=0..10)
neg = Negative(Value=vertical_pos)
neg_2 = Negative(Value=grid_size)
dom = ConstructDomain(DomainStart=grid_size, DomainEnd=neg_2)
pt_2 = ConstructPoint(XCoordinate=0, YCoordinate=neg, ZCoordinate=0)
rectangle = Rectangle(Plane=pt_2, XSize=dom, YSize=dom, Radius=0)  # -> Rectangle, Length
number_slider = Slider(2, range=0..100)
mplane = MeshPlane(Boundary=rectangle.Rectangle, WidthCount=number_slider, HeightCount=number_slider)  # -> Mesh, Area
demesh = DeconstructMesh(Mesh=mplane.Mesh)  # -> Vertices, Faces, Colours, Normals
pt_3 = Point(demesh.Vertices)

pdecon = Deconstruct(Point=pt)  # -> XComponent, YComponent, ZComponent
vec = VectorXYZ(XComponent=pdecon.XComponent, YComponent=pdecon.YComponent, ZComponent=0)  # -> Vector, Length
neg_3 = Negative(Value=b)
vlen = VectorLength(Vector=vec.Vector)
# separating hyperplan
unit = UnitVector(Vector=vec.Vector)

# ----
# xi with yi = 1
number_slider_2 = Slider(5, range=0..10)
neg_4 = Negative(Value=number_slider_2)
pt_4 = ConstructPoint(XCoordinate=0, YCoordinate=Slider(17, range=0..20), ZCoordinate=0)
dom_2 = ConstructDomain(DomainStart=number_slider_2, DomainEnd=neg_4)
rectangle_2 = Rectangle(Plane=pt_4, XSize=dom_2, YSize=dom_2, Radius=0)  # -> Rectangle, Length
mplane_2 = MeshPlane(Boundary=rectangle_2.Rectangle, WidthCount=Slider(2, range=1..10), HeightCount=Slider(2, range=1..10))  # -> Mesh, Area
demesh_2 = DeconstructMesh(Mesh=mplane_2.Mesh)  # -> Vertices, Faces, Colours, Normals
pt_5 = Point(demesh_2.Vertices)

origine = ConstructPoint(XCoordinate=0, YCoordinate=0, ZCoordinate=0)

# ----
# hyperplan representation
hyperplan_visible_half_length = Slider(27, range=0..100)
X = UnitX(Factor=1)
one_over_x = OneOverX(Value=vlen)
rev = Reverse(Vector=X)
rev_2 = Reverse(Vector=unit)
panel = Panel(one_over_x)
line = LineSDL(Start=origine, Direction=unit, Length=hyperplan_visible_half_length)
line_2 = LineSDL(Start=origine, Direction=rev_2, Length=hyperplan_visible_half_length)
line_3 = LineSDL(Start=origine, Direction=X, Length=hyperplan_visible_half_length)
line_4 = LineSDL(Start=origine, Direction=rev, Length=hyperplan_visible_half_length)
multiplication = Multiplication(A=neg_3, B=one_over_x)
merge = Merge(Data1=line, Data2=line_2)
merge_2 = Merge(Data1=line_3, Data2=line_4)
scale_nu = ScaleNU(Geometry=unit, Plane=PlaneXY(0, 0, 0), ScaleX=multiplication, ScaleY=multiplication, ScaleZ=1)  # -> Geometry, Transform
join = JoinCurves(Curves=merge, Preserve=False)
join_2 = JoinCurves(Curves=merge_2, Preserve=False)
rotate = Rotate(Geometry=join, Angle=1.570796327, Plane=PlaneXY(0, 0, 0))  # -> Geometry, Transform
move = Move(Geometry=rotate.Geometry, Motion=scale_nu.Geometry)  # -> Geometry, Transform

# ----
# risk calculation for yi=1
pt_6 = ConstructPoint(XCoordinate=0, YCoordinate=0, ZCoordinate=0)
vec2pt = Vector2Pt(PointA=pt_6, PointB=pt_5, Unitize=False)  # -> Vector, Length
dprod = DotProduct(VectorA=vec2pt.Vector, VectorB=vec.Vector, Unitize=False)
addition = Addition(A=dprod, B=b)
larger = LargerThan(FirstNumber=addition, SecondNumber=Slider(0, range=0..1))  # -> LargerThan, OrEqualTo

# ----
# risk calculation for yi=-1
pt_7 = ConstructPoint(XCoordinate=0, YCoordinate=0, ZCoordinate=0)
vec2pt_2 = Vector2Pt(PointA=pt_7, PointB=pt_3, Unitize=False)  # -> Vector, Length
dprod_2 = DotProduct(VectorA=vec2pt_2.Vector, VectorB=vec.Vector, Unitize=False)
addition_2 = Addition(A=dprod_2, B=b)

move_2 = Move(Geometry=origine, Motion=scale_nu.Geometry)  # -> Geometry, Transform
number_slider_3 = Slider(0.852, range=0..1)
number_slider_4 = Slider(0.21, range=0..1)

# ----
# W1 direction
vdis = VectorDisplay(Anchor=move_2.Geometry, Vector=vec.Vector)
vdis_2 = VectorDisplay(Anchor=move_2.Geometry, Vector=unit)

smaller = SmallerThan(FirstNumber=addition_2, SecondNumber=Slider(0, range=0..1))  # -> SmallerThan, OrEqualTo
dispatch = Dispatch(List=pt_3, DispatchPattern=smaller.OrEqualTo)  # -> ListA, ListB

# ----
# Risk from missclassified y=-1
dispatch_2 = Dispatch(List=addition_2, DispatchPattern=smaller.OrEqualTo)  # -> ListA, ListB
ma = MassAddition(Input=dispatch_2.ListB)  # -> Result, PartialResults
panel_2 = Panel(ma.Result)

dispatch_3 = Dispatch(List=pt_5, DispatchPattern=larger.OrEqualTo)  # -> ListA, ListB

# ----
# Risk from missclassified y=1
dispatch_4 = Dispatch(List=addition, DispatchPattern=larger.OrEqualTo)  # -> ListA, ListB
ma_2 = MassAddition(Input=dispatch_4.ListB)  # -> Result, PartialResults
neg_5 = Negative(Value=ma_2.Result)
panel_3 = Panel(neg_5)

pt_8 = Point(dispatch.ListA)
pt_9 = Point(dispatch.ListB)
pt_10 = Point(dispatch_3.ListA)
pt_11 = Point(dispatch_3.ListB)
panel_4 = Panel(dispatch_2.ListB)

# ----
# total risk
addition_3 = Addition(A=neg_5, B=ma.Result)
panel_5 = Panel(addition_3)

number_slider_5 = Slider(60, range=0..100)

# ----
# visualization of the line
vec_2 = VectorXYZ(XComponent=number_slider_5, YComponent=0, ZComponent=0)  # -> Vector, Length
move_3 = Move(Geometry=join_2, Motion=vec_2.Vector)  # -> Geometry, Transform
merge_3 = Merge(Data1=move.Geometry, Data2=move_3.Geometry)
hsv = ColourHSV(Alpha=1, Hue=0, Saturation=Slider(0.09, range=0..1), Value=1)
divide = DivideCurve(Curve=merge_3, Count=Slider(100, range=0..100), Kinks=False)  # -> Points, Tangents, Parameters
dots = DotDisplay(Point=divide.Points, Colour=hsv, Size=Slider(0.29, range=0..1))  # disabled

gallery = ImageGallery(CycleDelay=30, Randomize=False, UseLocalImages=True, UseRemoteImages=True)

# ----
# Gradiant for W, with y=-1
# Sum if all missclassified X
dispatch_5 = Dispatch(List=vec2pt_2.Vector, DispatchPattern=smaller.OrEqualTo)  # -> ListA, ListB
ma_3 = MassAddition(Input=dispatch_5.ListB)  # -> Result, PartialResults
rev_3 = Reverse(Vector=ma_3.Result)
pt_12 = ConstructPoint(XCoordinate=0, YCoordinate=0, ZCoordinate=0)
vdis_3 = VectorDisplay(Anchor=pt_12, Vector=rev_3)

# ----
# Gradiant for W, with y=1
# Sum if all missclassified X
dispatch_6 = Dispatch(List=vec2pt.Vector, DispatchPattern=larger.OrEqualTo)  # -> ListA, ListB
ma_4 = MassAddition(Input=dispatch_6.ListB)  # -> Result, PartialResults
pt_13 = ConstructPoint(XCoordinate=0, YCoordinate=0, ZCoordinate=0)
vdis_4 = VectorDisplay(Anchor=pt_13, Vector=ma_4.Result)

diffeomorphism_center = ConstructPoint(XCoordinate=number_slider_5, YCoordinate=0, ZCoordinate=0)

# ----
# difféomorphisme
dispatch_7 = Dispatch(List=addition_2, DispatchPattern=smaller.OrEqualTo)  # -> ListA, ListB
dispatch_8 = Dispatch(List=vec2pt_2.Vector, DispatchPattern=smaller.OrEqualTo)  # -> ListA, ListB
xprod = CrossProduct(VectorA=dispatch_8.ListA, VectorB=unit, Unitize=False)  # -> Vector, Length
xprod_2 = CrossProduct(VectorA=dispatch_8.ListB, VectorB=unit, Unitize=False)  # -> Vector, Length
devec = DeconstructVector(Vector=xprod.Vector)  # -> XComponent, YComponent, ZComponent
devec_2 = DeconstructVector(Vector=xprod_2.Vector)  # -> XComponent, YComponent, ZComponent
vec_3 = VectorXYZ(XComponent=devec.ZComponent, YComponent=dispatch_7.ListA, ZComponent=0)  # -> Vector, Length
vec_4 = VectorXYZ(XComponent=devec_2.ZComponent, YComponent=dispatch_7.ListB, ZComponent=0)  # -> Vector, Length
move_4 = Move(Geometry=diffeomorphism_center, Motion=vec_3.Vector)  # -> Geometry, Transform
move_5 = Move(Geometry=diffeomorphism_center, Motion=vec_4.Vector)  # -> Geometry, Transform

# ----
# Gradiant for B is sum of missclassied yi
lng = ListLength(List=dispatch_6.ListB)
lng_2 = ListLength(List=dispatch_5.ListB)
neg_6 = Negative(Value=lng_2)
panel_6 = Panel(lng)
panel_7 = Panel(neg_6)
addition_4 = Addition(A=lng, B=neg_6)
panel_8 = Panel(addition_4)

addition_5 = Addition(A=ma_4.Result, B=rev_3)
panel_9 = Panel(addition_5)
pt_14 = ConstructPoint(XCoordinate=0, YCoordinate=0, ZCoordinate=0)
move_6 = Move(Geometry=pt_14, Motion=scale_nu.Geometry)  # -> Geometry, Transform
multiplication_2 = Multiplication(A=unit, B=addition_4)
rev_4 = Reverse(Vector=multiplication_2)
vdis_5 = VectorDisplay(Anchor=move_6.Geometry, Vector=addition_5)
vdis_6 = VectorDisplay(Anchor=move_6.Geometry, Vector=rev_4)

merge_4 = Merge(Data1=pt_9, Data4=move_5.Geometry)
merge_5 = Merge(Data3=pt_8, Data4=move_4.Geometry)

# ----
# visualisation
hsv_2 = ColourHSV(Alpha=1, Hue=Slider(0.28, range=0..1), Saturation=Slider(0.84, range=0..1), Value=1)
hsv_3 = ColourHSV(Alpha=1, Hue=Slider(0.84, range=0..1), Saturation=Slider(0.84, range=0..1), Value=1)
dots_2 = DotDisplay(Point=merge_4, Colour=hsv_3, Size=number_slider_3)
dots_3 = DotDisplay(Point=merge_5, Colour=hsv_2, Size=number_slider_3)

move_7 = Move(Geometry=move_6.Geometry, Motion=rev_4)  # -> Geometry, Transform
ln = Line(StartPoint=move_6.Geometry, EndPoint=move_7.Geometry)
Y = UnitY(Factor=1)
rev_5 = Reverse(Vector=Y)
merge_6 = Merge(Data1=pt_5, Data2=pt_3)
Y_2 = UnitY(Factor=1)
length_line = LengthLine(Line=ln, Length=Slider(2, range=0..100), Strength=10)
anchor = Anchor(Point=merge_6, Strength=10000)
merge_7 = Merge(Data1=anchor, Data2=length_line)
solver = Solver(GoalObjects=merge_7, Reset=Toggle(False), Threshold=1e-15, Tolerance=0.01, On=Toggle(True))  # -> I, V, O
data = Data(solver.V)
panel_10 = Panel(solver.V)
panel_11 = Panel(solver.I)

# ----
# difféomorphisme
dispatch_9 = Dispatch(List=addition, DispatchPattern=larger.OrEqualTo)  # -> ListA, ListB
dispatch_10 = Dispatch(List=vec2pt.Vector, DispatchPattern=larger.OrEqualTo)  # -> ListA, ListB
xprod_3 = CrossProduct(VectorA=dispatch_10.ListA, VectorB=unit, Unitize=False)  # -> Vector, Length
xprod_4 = CrossProduct(VectorA=dispatch_10.ListB, VectorB=unit, Unitize=False)  # -> Vector, Length

devec_3 = DeconstructVector(Vector=xprod_3.Vector)  # -> XComponent, YComponent, ZComponent
devec_4 = DeconstructVector(Vector=xprod_4.Vector)  # -> XComponent, YComponent, ZComponent

vec_5 = VectorXYZ(XComponent=devec_3.ZComponent, YComponent=dispatch_9.ListA, ZComponent=0)  # -> Vector, Length
vec_6 = VectorXYZ(XComponent=devec_4.ZComponent, YComponent=dispatch_9.ListB, ZComponent=0)  # -> Vector, Length
move_8 = Move(Geometry=diffeomorphism_center, Motion=vec_5.Vector)  # -> Geometry, Transform
move_9 = Move(Geometry=diffeomorphism_center, Motion=vec_6.Vector)  # -> Geometry, Transform

panel_12 = Panel(xprod_3.Length)
merge_8 = Merge(Data2=pt_11, Data3=move_9.Geometry)
merge_9 = Merge(Data1=pt_10, Data2=move_8.Geometry)

# ----
# visualisation
hsv_4 = ColourHSV(Alpha=1, Hue=Slider(0.7, range=0..1), Saturation=Slider(0.94, range=0..1), Value=1)
hsv_5 = ColourHSV(Alpha=1, Hue=Slider(1, range=0..1), Saturation=Slider(0.95, range=0..1), Value=1)
dots_4 = DotDisplay(Point=merge_8, Colour=hsv_5, Size=number_slider_3)
dots_5 = DotDisplay(Point=merge_9, Colour=hsv_4, Size=number_slider_3)
