# Grasshopper definition Perceptron kangaroo v01.gh (Grasshopper 1.0.7)
# plug-ins: Kangaroo2 Components

w_0 = Slider(1.292, range=0..10)
w_1 = Slider(3.474, range=0..10)
# Single point for y=1
number_slider = Slider(8, range=0..100)
B = Slider(-61.5, range=-200..200)
neg = Negative(Value=B)
pt = ConstructPoint(XCoordinate=w_0, YCoordinate=w_1, ZCoordinate=0)
pt_2 = ConstructPoint(XCoordinate=number_slider, YCoordinate=Slider(6, range=0..100), ZCoordinate=0)
pt_3 = ConstructPoint(XCoordinate=0, YCoordinate=0, ZCoordinate=0)
tag = TextTag3D(Location=pt, Text="W", Size=1, Justification=7)
tag_2 = TextTag3D(Location=pt_2, Text="X1 for Y=1", Size=1, Justification=7)
vlen = VectorLength(Vector=pt)
unit = UnitVector(Vector=pt)
ln = Line(StartPoint=pt_3, EndPoint=pt_2)

# ----
# hyperplan representation
origine = ConstructPoint(XCoordinate=0, YCoordinate=0, ZCoordinate=0)
hyperplan_visible_half_length = Slider(27, range=0..100)
X = UnitX(Factor=1)
rev = Reverse(Vector=X)
one_over_x = OneOverX(Value=vlen)
rev_2 = Reverse(Vector=unit)
multiplication = Multiplication(A=neg, B=one_over_x)
panel = Panel(one_over_x)
line = LineSDL(Start=origine, Direction=unit, Length=hyperplan_visible_half_length)
line_2 = LineSDL(Start=origine, Direction=rev_2, Length=hyperplan_visible_half_length)
line_3 = LineSDL(Start=origine, Direction=X, Length=hyperplan_visible_half_length)
line_4 = LineSDL(Start=origine, Direction=rev, Length=hyperplan_visible_half_length)
merge = Merge(Data1=line, Data2=line_2)
merge_2 = Merge(Data1=line_3, Data2=line_4)
scale_nu = ScaleNU(Geometry=unit, Plane=PlaneXY(0, 0, 0), ScaleX=multiplication, ScaleY=multiplication, ScaleZ=1)  # -> Geometry, Transform
join = JoinCurves(Curves=merge, Preserve=False)
pt_4 = ConstructPoint(XCoordinate=0, YCoordinate=0, ZCoordinate=0)
join_2 = JoinCurves(Curves=merge_2, Preserve=False)
rotate = Rotate(Geometry=join, Angle=1.570796327, Plane=PlaneXY(0, 0, 0))  # -> Geometry, Transform
move = Move(Geometry=rotate.Geometry, Motion=scale_nu.Geometry)  # -> Geometry, Transform
move_2 = Move(Geometry=pt_4, Motion=scale_nu.Geometry)  # -> Geometry, Transform

length_line = LengthLine(Line=ln, Strength=10)
anchor = Anchor(Point=pt_3, Strength=10000)
anchor_2 = Anchor(Point=pt_2, Strength=10000)
number_slider_2 = Slider(20, range=0..100)
tag_3 = TextTag3D(Location=move_2.Geometry, Text="Separating hyperplan (at -B/|W|)", Size=1, Justification=7)
divide = DivideCurve(Curve=move.Geometry, Count=number_slider_2, Kinks=False)  # -> Points, Tangents, Parameters
number_slider_3 = Slider(72.4, range=-11..1000)
anchor_3 = Anchor(Point=divide.Points, Target=pt_2, Strength=Slider(0.012, range=0..1))
pline = PolyLine(Vertices=divide.Points, Closed=False)

explode = Explode(Curve=pline, Recursive=True)  # -> Segments, Vertices
shift = ShiftList(List=explode.Segments, Shift=1, Wrap=False)
# See also the 'Rod' example for a simpler
# way of achieving this.
length_line_2 = LengthLine(Line=explode.Segments, Length=2, Strength=number_slider_3)
short = ShortestList(ListA=explode.Segments, ListB=shift, TrimMode=2)  # -> ListA, ListB
angle = Angle(LineA=short.ListA, LineB=short.ListB, RestAngle=0, Strength=number_slider_3)

merge_3 = Merge(Data1=length_line, Data4=anchor, Data5=anchor_2, Data7=anchor_3, Data8=length_line_2, Data9=angle)  # -> flatten(Result)
solver = Solver(GoalObjects=merge_3, Reset=Toggle(False), Threshold=1e-15, Tolerance=0.01, On=Toggle(True))  # -> I, V, O
pt_5 = Point(solver.V)
panel_2 = Panel(solver.O)
data = Data(solver.O)
panel_3 = Panel(solver.I)
addition = Addition(A=number_slider_2, B=2)
panel_4 = Panel(solver.V)
item = ListItem(List=pt_5, Index=Slider(2, range=0..10), Wrap=True)
item_2 = ListItem(List=pt_5, Index=addition, Wrap=True)
ln_2 = Line(StartPoint=item, EndPoint=item_2)
vlen_2 = VectorLength(Vector=ln_2)
unit_2 = UnitVector(Vector=ln_2)

# ----
# hyperplan representation
origine_2 = ConstructPoint(XCoordinate=0, YCoordinate=0, ZCoordinate=0)
hyperplan_visible_half_length_2 = Slider(27, range=0..100)
X_2 = UnitX(Factor=1)
rev_3 = Reverse(Vector=X_2)
one_over_x_2 = OneOverX(Value=vlen_2)
rev_4 = Reverse(Vector=unit_2)
panel_5 = Panel(one_over_x_2)
line_5 = LineSDL(Start=origine_2, Direction=unit_2, Length=hyperplan_visible_half_length_2)
line_6 = LineSDL(Start=origine_2, Direction=rev_4, Length=hyperplan_visible_half_length_2)
line_7 = LineSDL(Start=origine_2, Direction=X_2, Length=hyperplan_visible_half_length_2)
line_8 = LineSDL(Start=origine_2, Direction=rev_3, Length=hyperplan_visible_half_length_2)
multiplication_2 = Multiplication(A=neg, B=one_over_x_2)
merge_4 = Merge(Data1=line_5, Data2=line_6)
merge_5 = Merge(Data1=line_7, Data2=line_8)
scale_nu_2 = ScaleNU(Geometry=unit_2, Plane=PlaneXY(0, 0, 0), ScaleX=multiplication_2, ScaleY=multiplication_2, ScaleZ=1)  # -> Geometry, Transform
join_3 = JoinCurves(Curves=merge_4, Preserve=False)
pt_6 = ConstructPoint(XCoordinate=0, YCoordinate=0, ZCoordinate=0)
join_4 = JoinCurves(Curves=merge_5, Preserve=False)
rotate_2 = Rotate(Geometry=join_3, Angle=1.570796327, Plane=PlaneXY(0, 0, 0))  # -> Geometry, Transform
move_3 = Move(Geometry=rotate_2.Geometry, Motion=scale_nu_2.Geometry)  # -> Geometry, Transform
move_4 = Move(Geometry=pt_6, Motion=scale_nu_2.Geometry)  # -> Geometry, Transform
