# Grasshopper definition egg cup v03 e.gh (Grasshopper 1.0.7)

# ----
# Unit Egg
# This function provides the egg
# radius according to the heigth
number_slider = Slider(305, range=0..500)
number = Number(0.1)
_1_5 = Number(-1.5)
series = Series(Start=_1_5, Step=Slider(0.01, range=0..0.01), Count=number_slider)
_11 = Number(11)
number_2 = Number(0.95)
number_3 = Number(1.5)
expression = Expression(z=series, a=number_3, b=number_2, c=_11, Expression="(1/b)*(1+z*a/c)*SQRT(1-(z/a)²)")
rev = ReverseList(List=expression)
addition = Addition(A=series, B=Slider(0, range=0..100), C=1.5)
sort = SortList(Keys=rev, ValuesA=addition)  # -> Keys, ValuesA
pt = ConstructPoint(XCoordinate=0, YCoordinate=0, ZCoordinate=0)
lng = ListLength(List=sort.Keys)
line = LineSDL(Start=pt, Direction=Vector(0, 0, 1), Length=1)
pt_2 = ConstructPoint(XCoordinate=rev, YCoordinate=0, ZCoordinate=addition)
subtraction = Subtraction(A=lng, B=1)
unit_egg_largest_radius = ListItem(List=sort.Keys, Index=subtraction, Wrap=True)
intcrv = Interpolate(Vertices=pt_2, Degree=3, Periodic=False, KnotStyle=1)  # -> Curve, Length, Domain
# Largest radius
item = ListItem(List=sort.ValuesA, Index=subtraction, Wrap=True)
revsrf = Revolution(Curve=intcrv.Curve, Axis=line, Domain=Domain(0, 6.283185307))
multiplication = Multiplication(A=item, B=Slider(1, range=0..1))

# ----
# The egg cup shape shall be manufacturable for ceramic
egg_density = Number(1.031)
medium_egg_weight = Slider(53, range=0..100)
offset = Slider(0.19805, range=0..1)
# the egg cup shall fit int the top drawer of the washing machine
# Five instances of the egg cup shall stack on less than 15 cm.
# the egg cup shall fit medium, large and extra large size of eggs (EU standard, http://www.unece.org/fileadmin/DAM/trade/agr/standard/eggs/Standards/EGG01_EggsInShell_2010E.pdf).
# 
# miminum mass
# Extra large (XL)
# 73 g
# Large (L)
# 63 g
# Medium (M)
# 53 g
# Small (S)
# Less than 53 g
# Density is 1.031 g/cm3
extra_large_egg_weight = Slider(73, range=0..100)
large_egg_weight = Slider(63, range=0..100)

cap = CapHoles(Brep=revsrf)
volume_mm3 = Volume(Geometry=cap)  # -> Volume, Centroid
weigth_mg = Division(A=volume_mm3.Volume, B=egg_density)

panel = Panel(multiplication)
division = Division(A=extra_large_egg_weight, B=weigth_mg)
cbrt = CubeRoot(Value=division)
scale = Scale(Geometry=revsrf, Center=Point(0, 0, 0), Factor=cbrt)  # -> Geometry, Transform
multiplication_2 = Multiplication(A=multiplication, B=cbrt)
multiplication_3 = Multiplication(A=unit_egg_largest_radius, B=cbrt)

cap_2 = CapHoles(Brep=scale.Geometry)
volume_in_mm3 = Volume(Geometry=cap_2)  # -> Volume, Centroid
panel_2 = Panel(volume_in_mm3.Volume)

# ----
# Minimum weigth for XL egg is 73 g, hence 73000 mg
weight_mg = Division(A=volume_in_mm3.Volume, B=egg_density)
panel_3 = Panel(weight_mg)

cluster = Cluster(A=multiplication_2, relay_2=multiplication_3, relay=offset, G=scale.Geometry)  # -> B, R
division_2 = Division(A=large_egg_weight, B=weigth_mg)
cbrt_2 = CubeRoot(Value=division_2)
scale_2 = Scale(Geometry=revsrf, Center=Point(0, 0, 0), Factor=cbrt_2)  # -> Geometry, Transform
multiplication_4 = Multiplication(A=multiplication, B=cbrt_2)
multiplication_5 = Multiplication(A=unit_egg_largest_radius, B=cbrt_2)

cap_3 = CapHoles(Brep=scale_2.Geometry)
volume_in_mm3_2 = Volume(Geometry=cap_3)  # -> Volume, Centroid
panel_4 = Panel(volume_in_mm3_2.Volume)

cluster_2 = Cluster_2(A=multiplication_4, relay=multiplication_5, relay_2=offset, G=scale_2.Geometry)  # -> B, R

# ----
# Minimum weigth for L egg is 63 g
weight_mg_2 = Division(A=volume_in_mm3_2.Volume, B=egg_density)
panel_5 = Panel(weight_mg_2)

vec = VectorXYZ(XComponent=Slider(3.3, range=0..10), YComponent=Slider(3.4, range=0..10), ZComponent=0)  # -> Vector, Length
move = Move(Geometry=cluster_2.B, Motion=vec.Vector)  # -> Geometry, Transform
move_2 = Move(Geometry=cluster_2.R, Motion=vec.Vector)  # -> Geometry, Transform
division_3 = Division(A=medium_egg_weight, B=weigth_mg)
cbrt_3 = CubeRoot(Value=division_3)
scale_3 = Scale(Geometry=revsrf, Center=Point(0, 0, 0), Factor=cbrt_3)  # -> Geometry, Transform
multiplication_6 = Multiplication(A=multiplication, B=cbrt_3)
multiplication_7 = Multiplication(A=unit_egg_largest_radius, B=cbrt_3)

cap_4 = CapHoles(Brep=scale_3.Geometry)
volume_in_mm3_3 = Volume(Geometry=cap_4)  # -> Volume, Centroid
panel_6 = Panel(volume_in_mm3_3.Volume)

cluster_3 = Cluster_2(A=multiplication_6, relay=multiplication_7, relay_2=offset, G=scale_3.Geometry)  # -> B, R

# ----
# Minimum weigth for M egg is 53 g
weight_mg_3 = Division(A=volume_in_mm3_3.Volume, B=egg_density)
panel_7 = Panel(weight_mg_3)

vec_2 = VectorXYZ(XComponent=Slider(8.1, range=0..10), YComponent=Slider(4.8, range=0..10), ZComponent=0)  # -> Vector, Length
move_3 = Move(Geometry=cluster_3.B, Motion=vec_2.Vector)  # -> Geometry, Transform
move_4 = Move(Geometry=cluster_3.R, Motion=vec_2.Vector)  # -> Geometry, Transform
merge = Merge(Data1=cluster.B, Data2=move.Geometry)
sunion = SolidUnion(Breps=merge)
merge_2 = Merge(Data1=move.Geometry, Data2=move_3.Geometry)
merge_3 = Merge(Data1=cluster.B, Data2=move_3.Geometry)
sdiff = SolidDifference(BrepsA=move_4.Geometry, BrepsB=sunion)
sunion_2 = SolidUnion(Breps=merge_3)
sunion_3 = SolidUnion(Breps=merge_2)
sdiff_2 = SolidDifference(BrepsA=cluster.R, BrepsB=sunion_3)
sdiff_3 = SolidDifference(BrepsA=move_2.Geometry, BrepsB=sunion_2)
merge_4 = Merge(Data1=sdiff_2, Data2=sdiff_3, Data3=sdiff)
sunion_4 = SolidUnion(Breps=merge_4)

# ==== cluster Cluster
G = ClusterInput()
A = ClusterInput()
relay = ClusterInput()
relay_2 = ClusterInput()

angle_of_the_vecttor_at_bottom_of_slope = Slider(191, range=0..360)
elevation_of_the_extra_large_egg = Slider(0.713, range=0..1)
intensity_of_the_vector_at_top_of_slope = Slider(1.257, range=1..5)
angle_at_top_of_slope = Slider(79.9, range=0..360)
addtionnal_radius_at_bottom = Slider(2.715, range=0..5)
intensity_of_the_vecttor_at_bottom_of_sl = Slider(1.884, range=1..10)  # "Intensity of the vecttor at bottom of slope"

addition = Addition(A=relay_2, B=addtionnal_radius_at_bottom)
addition_2 = Addition(A=A, B=elevation_of_the_extra_large_egg)
X = UnitX(Factor=intensity_of_the_vector_at_top_of_slope)
Y = UnitY(Factor=1)
X_2 = UnitX(Factor=intensity_of_the_vecttor_at_bottom_of_sl)
Y_2 = UnitY(Factor=1)
volcano_slope_at_the_bottom = Rotate(Vector=X_2, Axis=Y_2, Angle=degrees(angle_of_the_vecttor_at_bottom_of_slope))
# The egg cup is a volcano.
# The top radius is the top of the volcano
# The bottom radius is the bottom of the volcano
volcano_top_point = ConstructPoint(XCoordinate=relay_2, YCoordinate=0, ZCoordinate=addition_2)
volcano_slope_at_the_top = Rotate(Vector=X, Axis=Y, Angle=degrees(angle_at_top_of_slope))
volcano_bottom_point = ConstructPoint(XCoordinate=addition, YCoordinate=0, ZCoordinate=0)
volcano_slope = BezierSpan(
    StartPoint=volcano_bottom_point,
    StartTangent=volcano_slope_at_the_bottom,
    EndPoint=volcano_top_point,
    EndTangent=volcano_slope_at_the_top)  # -> Curve, Length, Domain
pt = Point(Point(0, 0, 0))
line = LineSDL(Start=pt, Direction=Vector(0, 0, 1), Length=1)
revsrf = Revolution(Curve=volcano_slope.Curve, Axis=line, Domain=Domain(0, 6.283185307))
Z = UnitZ(Factor=elevation_of_the_extra_large_egg)
neg = Negative(Value=relay)
move = Move(Geometry=G, Motion=Z)  # -> Geometry, Transform
offset = Offset(Surface=revsrf, Distance=neg, Retrim=True)
offset_2 = Offset(Surface=move.Geometry, Distance=relay, Retrim=True)
cap = CapHoles(Brep=revsrf)
cap_2 = CapHoles(Brep=offset_2)
cap_3 = CapHoles(Brep=offset)
sdiff = SolidDifference(BrepsA=cap, BrepsB=move.Geometry)
sdiff_2 = SolidDifference(BrepsA=cap_3, BrepsB=cap_2)
list = ValueList({"One": 1, "Two": 2, "Three": 2² - 1, "Four": Sqrt(16)}, selected="Four")
list_2 = ValueList({"One": 1, "Two": 2, "Three": 2² - 1, "Four": Sqrt(16)}, selected="Two")
filedge = FilletEdge(Shape=sdiff_2, Blend=0, Metric=0, Edges=list, Radii=relay)
B = ClusterOutput(filedge)
filedge_2 = FilletEdge(Shape=sdiff, Blend=0, Metric=0, Edges=list_2, Radii=relay)
sdiff_3 = SolidDifference(BrepsA=filedge_2, BrepsB=filedge)
R = ClusterOutput(sdiff_3)

# ==== cluster Cluster_2
relay = ClusterInput()

angle_of_the_vecttor_at_bottom_of_slope = Slider(191, range=0..360)
elevation_of_the_extra_large_egg = Slider(0.713, range=0..1)
intensity_of_the_vector_at_top_of_slope = Slider(1.257, range=1..5)
angle_at_top_of_slope = Slider(79.9, range=0..360)
addtionnal_radius_at_bottom = Slider(2.715, range=0..5)
intensity_of_the_vecttor_at_bottom_of_sl = Slider(1.884, range=1..10)  # "Intensity of the vecttor at bottom of slope"

A = ClusterInput()
addition = Addition(A=relay, B=addtionnal_radius_at_bottom)
addition_2 = Addition(A=A, B=elevation_of_the_extra_large_egg)
X = UnitX(Factor=intensity_of_the_vector_at_top_of_slope)
Y = UnitY(Factor=1)
X_2 = UnitX(Factor=intensity_of_the_vecttor_at_bottom_of_sl)
Y_2 = UnitY(Factor=1)
volcano_slope_at_the_bottom = Rotate(Vector=X_2, Axis=Y_2, Angle=degrees(angle_of_the_vecttor_at_bottom_of_slope))
# The egg cup is a volcano.
# The top radius is the top of the volcano
# The bottom radius is the bottom of the volcano
volcano_top_point = ConstructPoint(XCoordinate=relay, YCoordinate=0, ZCoordinate=addition_2)
volcano_slope_at_the_top = Rotate(Vector=X, Axis=Y, Angle=degrees(angle_at_top_of_slope))
volcano_bottom_point = ConstructPoint(XCoordinate=addition, YCoordinate=0, ZCoordinate=0)
volcano_slope = BezierSpan(
    StartPoint=volcano_bottom_point,
    StartTangent=volcano_slope_at_the_bottom,
    EndPoint=volcano_top_point,
    EndTangent=volcano_slope_at_the_top)  # -> Curve, Length, Domain
pt = Point(Point(0, 0, 0))
line = LineSDL(Start=pt, Direction=Vector(0, 0, 1), Length=1)
revsrf = Revolution(Curve=volcano_slope.Curve, Axis=line, Domain=Domain(0, 6.283185307))
relay_2 = ClusterInput()
G = ClusterInput()
Z = UnitZ(Factor=elevation_of_the_extra_large_egg)
neg = Negative(Value=relay_2)
move = Move(Geometry=G, Motion=Z)  # -> Geometry, Transform
offset = Offset(Surface=revsrf, Distance=neg, Retrim=True)
offset_2 = Offset(Surface=move.Geometry, Distance=relay_2, Retrim=True)
cap = CapHoles(Brep=revsrf)
cap_2 = CapHoles(Brep=offset_2)
cap_3 = CapHoles(Brep=offset)
sdiff = SolidDifference(BrepsA=cap, BrepsB=move.Geometry)
sdiff_2 = SolidDifference(BrepsA=cap_3, BrepsB=cap_2)
list = ValueList({"One": 1, "Two": 2, "Three": 2² - 1, "Four": Sqrt(16)}, selected="Four")
list_2 = ValueList({"One": 1, "Two": 2, "Three": 2² - 1, "Four": Sqrt(16)}, selected="Two")
filedge = FilletEdge(Shape=sdiff_2, Blend=0, Metric=0, Edges=list, Radii=relay_2)
filedge_2 = FilletEdge(Shape=sdiff, Blend=0, Metric=0, Edges=list_2, Radii=relay_2)
B = ClusterOutput(filedge)
sdiff_3 = SolidDifference(BrepsA=filedge_2, BrepsB=filedge)
R = ClusterOutput(sdiff_3)
