# Grasshopper definition lorenz attractor v01.gh (Grasshopper 1.0.4)

number_slider = Slider(0, range=0..1)
c_script = CSharpScript(play=Toggle(False))  # -> out, A; inputs play: Boolean
# ---------- c_script: C# ----------
	double sigma = 10.0;
	double rho = 28;
	double beta = 8.0 / 3.0 ;
	double t = 0.01;

	if (play) {
		double dx = (sigma * (y - x)) * t ;
		double dy = (x * (rho - z) - y) * t ;
		double dz = (x * y - beta * z) * t;

		x = x + dx;
		y = y + dy;
		z = z + dz;

		Point3d pt = new Point3d( x, y, z);

		Print( dx.ToString());

		A = pt;
		Component.ExpireSolution( true);

	} else
	{
		t = 0.0;
		x = 0.01;
		y = 0;
		z = 0;

	}
# ---------- c_script: C# additional code ----------
double x = 0.01;
double y = 0.0;
double z = 0.0;
# ---------- end c_script ----------
c_script_2 = CSharpScript()  # -> out, A
# ---------- c_script_2: C# additional code ----------
  /// <summary>
  /// This method will be called once every solution, before any calls to RunScript.
  /// </summary>
  public override void BeforeRunScript()
  { }
  /// <summary>
  /// This method will be called once every solution, after any calls to RunScript.
  /// </summary>
  public override void AfterRunScript()
  { }
# ---------- end c_script_2 ----------
rec = DataRecorder(c_script.A, DataLimit=-10, RecordData=True)
rec_2 = DataRecorder(c_script.A, DataLimit=-10, RecordData=True)
panel = Panel(c_script.A)
graph = QuickGraph(rec)
intcrv = Interpolate(Vertices=rec_2, Degree=3, Periodic=False, KnotStyle=1)  # -> Curve, Length, Domain
preview = CustomPreview(Geometry=intcrv.Curve, Shader=ColourSwatch(SwatchColor=RGB(214, 47, 47)))
