# Grasshopper definition neural network basic 1 layer perceptron.ghx (Grasshopper 1.0.7)

b = Slider(-3.3, range=-20..20)
w_y = Slider(3.8, range=-10..10)
w_x = Slider(4.2, range=-10..10)

# ----
# xi with yi = 1
number_slider = Slider(6, range=0..10)
neg = Negative(Value=number_slider)
pt = ConstructPoint(XCoordinate=0, YCoordinate=Slider(10, range=0..10), ZCoordinate=0)
dom = ConstructDomain(DomainStart=number_slider, DomainEnd=neg)
number_slider_2 = Slider(8, range=0..100)
rectangle = Rectangle(Plane=pt, XSize=dom, YSize=dom, Radius=0)  # -> Rectangle, Length
mplane = MeshPlane(Boundary=rectangle.Rectangle, WidthCount=number_slider_2, HeightCount=number_slider_2)  # -> Mesh, Area
demesh = DeconstructMesh(Mesh=mplane.Mesh)  # -> Vertices, Faces, Colours, Normals
pt_2 = Point(demesh.Vertices)

# ----
# xi with yi = -1
grid_size = Slider(6, range=0..10)
vertical_pos = Slider(10, range=0..10)
neg_2 = Negative(Value=vertical_pos)
neg_3 = Negative(Value=grid_size)
pt_3 = ConstructPoint(XCoordinate=0, YCoordinate=neg_2, ZCoordinate=0)
dom_2 = ConstructDomain(DomainStart=grid_size, DomainEnd=neg_3)
# separating hyperplan
number_slider_3 = Slider(8, range=0..100)
rectangle_2 = Rectangle(Plane=pt_3, XSize=dom_2, YSize=dom_2, Radius=0)  # -> Rectangle, Length
mplane_2 = MeshPlane(Boundary=rectangle_2.Rectangle, WidthCount=number_slider_3, HeightCount=number_slider_3)  # -> Mesh, Area
demesh_2 = DeconstructMesh(Mesh=mplane_2.Mesh)  # -> Vertices, Faces, Colours, Normals
pt_4 = Point(demesh_2.Vertices)

vec = VectorXYZ(XComponent=w_x, YComponent=w_y, ZComponent=0)  # -> Vector, Length
neg_4 = Negative(Value=b)
pt_5 = ConstructPoint(XCoordinate=0, YCoordinate=0, ZCoordinate=0)
pt_6 = ConstructPoint(XCoordinate=0, YCoordinate=0, ZCoordinate=0)
vec2pt = Vector2Pt(PointA=pt_5, PointB=pt_2, Unitize=False)  # -> Vector, Length
vec2pt_2 = Vector2Pt(PointA=pt_6, PointB=pt_4, Unitize=False)  # -> Vector, Length
# risk calculation for yi=1
vdis = VectorDisplay(Anchor=pt_5, Vector=vec2pt.Vector)
# risk calculation for yi=1
vdis_2 = VectorDisplay(Anchor=pt_6, Vector=vec2pt_2.Vector)
dprod = DotProduct(VectorA=vec2pt.Vector, VectorB=vec.Vector, Unitize=False)
dprod_2 = DotProduct(VectorA=vec2pt_2.Vector, VectorB=vec.Vector, Unitize=False)
number_slider_4 = Slider(0.21, range=0..1)
addition = Addition(A=dprod, B=b)
addition_2 = Addition(A=dprod_2, B=b)
larger = LargerThan(FirstNumber=addition, SecondNumber=Slider(0, range=0..1))  # -> LargerThan, OrEqualTo
smaller = SmallerThan(FirstNumber=addition_2, SecondNumber=Slider(0, range=0..1))  # -> SmallerThan, OrEqualTo
dispatch = Dispatch(List=pt_2, DispatchPattern=larger.OrEqualTo)  # -> ListA, ListB
dispatch_2 = Dispatch(List=pt_4, DispatchPattern=smaller.OrEqualTo)  # -> ListA, ListB
hsv = ColourHSV(Alpha=1, Hue=number_slider_4, Saturation=1, Value=1)
number_slider_5 = Slider(0.273, range=0..1)
hsv_2 = ColourHSV(Alpha=1, Hue=0, Saturation=1, Value=1)
pt_7 = Point(dispatch.ListA)
pt_8 = Point(dispatch.ListB)
number_slider_6 = Slider(0.273, range=0..1)
pt_9 = Point(dispatch_2.ListA)
pt_10 = Point(dispatch_2.ListB)
hsv_3 = ColourHSV(Alpha=1, Hue=0, Saturation=1, Value=1)
hsv_4 = ColourHSV(Alpha=1, Hue=number_slider_4, Saturation=1, Value=1)
dots = DotDisplay(Point=pt_7, Colour=hsv_4, Size=number_slider_5)
dots_2 = DotDisplay(Point=pt_8, Colour=hsv_3, Size=number_slider_5)
dots_3 = DotDisplay(Point=pt_9, Colour=hsv, Size=number_slider_6)
dots_4 = DotDisplay(Point=pt_10, Colour=hsv_2, Size=number_slider_6)

# ----
# hyperplan representation
hyperplan_visible_half_length = Slider(27, range=0..100)
origine = ConstructPoint(XCoordinate=0, YCoordinate=0, ZCoordinate=0)
vlen = VectorLength(Vector=vec.Vector)
one_over_x = OneOverX(Value=vlen)
scale = Scale(Geometry=vec.Vector, Center=Point(0, 0, 0), Factor=one_over_x)  # -> Geometry, Transform
vdis_3 = VectorDisplay(Anchor=origine, Vector=vec.Vector)
X = UnitX(Factor=1)
rev = Reverse(Vector=scale.Geometry)
line = LineSDL(Start=origine, Direction=scale.Geometry, Length=hyperplan_visible_half_length)
line_2 = LineSDL(Start=origine, Direction=rev, Length=hyperplan_visible_half_length)
vdis_4 = VectorDisplay(Anchor=origine, Vector=scale.Geometry)
merge = Merge(Data1=line, Data2=line_2)
angle = Angle(VectorA=X, VectorB=scale.Geometry)  # -> Angle, Reflex
join = JoinCurves(Curves=merge, Preserve=False)
rotate = Rotate(Geometry=join, Angle=1.570796327, Plane=PlaneXY(0, 0, 0))  # -> Geometry, Transform

multiplication = Multiplication(A=neg_4, B=one_over_x)
scale_nu = ScaleNU(Geometry=scale.Geometry, Plane=PlaneXY(0, 0, 0), ScaleX=multiplication, ScaleY=multiplication, ScaleZ=1)  # -> Geometry, Transform

move = Move(Geometry=rotate.Geometry, Motion=scale_nu.Geometry)  # -> Geometry, Transform
